# Grasshopper definition admin.ghx (Grasshopper 1.0.7)

admin = GetString(AtLeast=1, AtMost=1, TreeAccess=True)
curves = GetGeometry(AtLeast=1, AtMost=2147483647, DeleteInput=False, Filter=1074004029, TreeAccess=True)
flatten = FlattenTree(Tree=admin, Path="{0}")
cset = CreateSet(List=flatten)  # -> Set, Map
flatten_2 = FlattenTree(Tree=curves, Path="{0}")
lng = ListLength(List=cset.Set)  # -> expr("x-1", Length)
gradient = Gradient(
    LowerLimit=0,
    UpperLimit=lng,
    Parameter=cset.Map,
    stops=[0: RGB(220, 220, 220), 0.5: RGB(0, 128, 128), 1: RGB(47, 66, 244)])
area = Area(Geometry=flatten_2)  # -> Area, Centroid
sort = SortList(Keys=area.Area, ValuesA=flatten_2, ValuesB=gradient, ValuesC=flatten)  # -> Keys, ValuesA, ValuesB, ValuesC
mcol = MeshColours(Mesh=graft(sort.ValuesA), Colours=graft(sort.ValuesB))

# ---- group: RH_OUT:AdminBound
txt = Text(flatten(sort.ValuesC))

# ---- group: RH_OUT:Mesh
mesh = Mesh(flatten(mcol))
