# Grasshopper definition buildingsColor.ghx (Grasshopper 1.0.7)
# plug-ins: GraphicPlus

filename = GetString(AtLeast=1, AtMost=2147483647, TreeAccess=True)
geometry = GetGeometry(AtLeast=1, AtMost=2147483647, DeleteInput=False, Filter=1074004029, TreeAccess=True)
foldername = GetString(AtLeast=1, AtMost=1, TreeAccess=False)
flatten = FlattenTree(Tree=filename, Path="{0}")
flatten_2 = FlattenTree(Tree=geometry, Path="{0}")
flatten_3 = FlattenTree(Tree=foldername, Path="{0}")
number_slider = Slider(2000, range=0..10000)
concat = Concatenate(FragmentA="C:\Users\Administrator\OneDrive - nettletontribe\Compute\", FragmentB=flatten_3)
dom = ConstructDomain(DomainStart=expr("-x", number_slider), DomainEnd=number_slider)
stroke = Stroke(ShapeGeometry=flatten_2, Color=ColourSwatch(SwatchColor=RGB(128, 128, 128)), Weight=1, EndCap=0)
rectangle = Rectangle(Plane=PlaneXY(0, 0, 0), XSize=dom, YSize=dom, Radius=0)  # -> Rectangle, Length
drawing = ConstructDrawing(ShapesGeometry=stroke, Boundary=rectangle.Rectangle, Color=RGBA(255, 255, 255, 0))  # -> Drawing, Boundary
savebmp = SaveBitmap(
    DrawingsShapesGeometry=drawing.Drawing,
    FolderPath=concat,
    FileName=flatten,
    Extension=0,
    Resolution=96,
    Save=Toggle(True))

# ---- group: RH_OUT:Path
data = Data(savebmp)
