# Grasshopper definition bushfire.ghx (Grasshopper 1.0.7)

bushfire = GetString(AtLeast=1, AtMost=2147483647, TreeAccess=True)
curves = GetGeometry(AtLeast=1, AtMost=2147483647, DeleteInput=False, Filter=1074004029, TreeAccess=True)
flatten = FlattenTree(Tree=bushfire, Path="{0}")
flatten_2 = FlattenTree(Tree=curves, Path="{0}")
cset = CreateSet(List=flatten)  # -> Set, Map
lng = ListLength(List=cset.Set)  # -> expr("x-1", Length)
gradient = Gradient(LowerLimit=0, UpperLimit=lng, Parameter=cset.Map, stops=[0.15: RGB(255, 130, 160), 0.85: RGB(220, 0, 40)])
mcol = MeshColours(Mesh=graft(flatten_2), Colours=graft(gradient))

# ---- group: RH_OUT:ClassBF
txt = Text(flatten(flatten))

# ---- group: RH_OUT:Mesh
mesh = Mesh(flatten(mcol))
