# Grasshopper definition fsr.ghx (Grasshopper 1.0.7)

fsr = GetString(AtLeast=1, AtMost=2147483647, TreeAccess=True)
curves = GetGeometry(AtLeast=1, AtMost=2147483647, DeleteInput=False, Filter=1074004029, TreeAccess=True)
flatten = FlattenTree(Tree=fsr, Path="{0}")
flatten_2 = FlattenTree(Tree=curves, Path="{0}")
sort = SortList(Keys=flatten, ValuesA=flatten_2)  # -> Keys, ValuesA
cset = CreateSet(List=sort.Keys)  # -> Set, Map
lng = ListLength(List=cset.Set)  # -> expr("x-1", Length)
gradient = Gradient(
    LowerLimit=0,
    UpperLimit=lng,
    Parameter=cset.Map,
    stops=[0: RGB(245, 222, 179), 0.5: RGB(210, 180, 140), 1: RGB(205, 133, 63)])
boundary = BoundarySurfaces(Edges=graft(sort.ValuesA))  # -> flatten(Surfaces)

# ---- group: RH_OUT:Values
txt = Text(flatten(sort.Keys))

# ---- group: RH_OUT:Surface
geo = Geometry(boundary)

# ---- group: RH_OUT:Colors
txt_2 = Text(gradient)
