# Grasshopper definition mls.ghx (Grasshopper 1.0.7)

mls = GetString(AtLeast=1, AtMost=2147483647, TreeAccess=True)
curves = GetGeometry(AtLeast=1, AtMost=2147483647, DeleteInput=False, Filter=1074004029, TreeAccess=True)
flatten = FlattenTree(Tree=mls, Path="{0}")
flatten_2 = FlattenTree(Tree=curves, Path="{0}")
cset = CreateSet(List=flatten)  # -> Set, Map
lng = ListLength(List=cset.Set)  # -> expr("x-1", Length)
gradient = Gradient(
    LowerLimit=0,
    UpperLimit=lng,
    Parameter=cset.Map,
    stops=[0: RGB(240, 255, 240), 0.5: RGB(143, 188, 143), 1: RGB(46, 139, 87)])
boundary = BoundarySurfaces(Edges=graft(flatten_2))  # -> flatten(Surfaces)

# ---- group: RH_OUT:Values
txt = Text(flatten(flatten))

# ---- group: RH_OUT:Surface
geo = Geometry(boundary)

# ---- group: RH_OUT:Colors
txt_2 = Text(gradient)
