# Grasshopper definition topoSpeckle.ghx (Grasshopper 1.0.7)
# plug-ins: Speckle 2

rendermaterial = RenderMaterial(
    Opacity="1",
    Metalness="0",
    Roughness="1",
    Diffuse=ColourSwatch(SwatchColor=RGB(122, 122, 122)),
    SelectedConstructorName="Objects.Other.RenderMaterial.ctor(System.Double,System.Double,System.Double,System.Nullable`1[System.Drawing.Color],System.Nullable`1[System.Drawing.Color])",
    SelectedTypeName="Objects.Other.RenderMaterial",
    UseSchemaTag=False,
    UserSetSchemaTag=False,
    seed="203aa48e2cb00c0caa01")
rendermaterial_2 = RenderMaterial(
    Opacity="1",
    Metalness="0",
    Roughness="1",
    Diffuse=ColourSwatch(SwatchColor=RGB(199, 199, 199)),
    SelectedConstructorName="Objects.Other.RenderMaterial.ctor(System.Double,System.Double,System.Double,System.Nullable`1[System.Drawing.Color],System.Nullable`1[System.Drawing.Color])",
    SelectedTypeName="Objects.Other.RenderMaterial",
    UseSchemaTag=False,
    UserSetSchemaTag=False,
    seed="e6a53fccf3c8622d4947")
rendermaterial_3 = RenderMaterial(
    Opacity="1",
    Metalness="0",
    Roughness="1",
    Diffuse=ColourSwatch(SwatchColor=RGB(199, 199, 199)),
    SelectedConstructorName="Objects.Other.RenderMaterial.ctor(System.Double,System.Double,System.Double,System.Nullable`1[System.Drawing.Color],System.Nullable`1[System.Drawing.Color])",
    SelectedTypeName="Objects.Other.RenderMaterial",
    UseSchemaTag=False,
    UserSetSchemaTag=False,
    seed="621402ed835097216427")
rendermaterial_4 = RenderMaterial(
    Opacity="1",
    Metalness="0",
    Roughness="1",
    Diffuse=ColourSwatch(SwatchColor=RGB(199, 199, 199)),
    SelectedConstructorName="Objects.Other.RenderMaterial.ctor(System.Double,System.Double,System.Double,System.Nullable`1[System.Drawing.Color],System.Nullable`1[System.Drawing.Color])",
    SelectedTypeName="Objects.Other.RenderMaterial",
    UseSchemaTag=False,
    UserSetSchemaTag=False,
    seed="26f6d0ed2cf9261f693a")
rendermaterial_5 = RenderMaterial(
    Opacity="1",
    Metalness="0",
    Roughness="1",
    Diffuse=ColourSwatch(SwatchColor=RGB(199, 199, 199)),
    SelectedConstructorName="Objects.Other.RenderMaterial.ctor(System.Double,System.Double,System.Double,System.Nullable`1[System.Drawing.Color],System.Nullable`1[System.Drawing.Color])",
    SelectedTypeName="Objects.Other.RenderMaterial",
    UseSchemaTag=False,
    UserSetSchemaTag=False,
    seed="58a0b8561ac3c028c0e7")
rendermaterial_6 = RenderMaterial(
    Opacity="1",
    Metalness="0",
    Roughness="1",
    Diffuse=ColourSwatch(SwatchColor=RGB(199, 199, 199)),
    SelectedConstructorName="Objects.Other.RenderMaterial.ctor(System.Double,System.Double,System.Double,System.Nullable`1[System.Drawing.Color],System.Nullable`1[System.Drawing.Color])",
    SelectedTypeName="Objects.Other.RenderMaterial",
    UseSchemaTag=False,
    UserSetSchemaTag=False,
    seed="957bce11b6189a06f26d")
rendermaterial_7 = RenderMaterial(
    Opacity="1",
    Metalness="0",
    Roughness="1",
    Diffuse=ColourSwatch(SwatchColor=RGB(193, 9, 235)),
    SelectedConstructorName="Objects.Other.RenderMaterial.ctor(System.Double,System.Double,System.Double,System.Nullable`1[System.Drawing.Color],System.Nullable`1[System.Drawing.Color])",
    SelectedTypeName="Objects.Other.RenderMaterial",
    UseSchemaTag=False,
    UserSetSchemaTag=False,
    seed="171296fe02e1b90dbac8")
rendermaterial_8 = RenderMaterial(
    Opacity="1",
    Metalness="0",
    Roughness="1",
    Diffuse=ColourSwatch(SwatchColor=RGB(122, 122, 122)),
    SelectedConstructorName="Objects.Other.RenderMaterial.ctor(System.Double,System.Double,System.Double,System.Nullable`1[System.Drawing.Color],System.Nullable`1[System.Drawing.Color])",
    SelectedTypeName="Objects.Other.RenderMaterial",
    UseSchemaTag=False,
    UserSetSchemaTag=False,
    seed="1189eb6bb6f8a1259360")
rendermaterial_9 = RenderMaterial(
    Opacity="1",
    Metalness="0",
    Roughness="1",
    Diffuse=ColourSwatch(SwatchColor=RGB(201, 201, 201)),
    SelectedConstructorName="Objects.Other.RenderMaterial.ctor(System.Double,System.Double,System.Double,System.Nullable`1[System.Drawing.Color],System.Nullable`1[System.Drawing.Color])",
    SelectedTypeName="Objects.Other.RenderMaterial",
    UseSchemaTag=False,
    UserSetSchemaTag=False,
    seed="a733d1989930408f1873")
rendermaterial_10 = RenderMaterial(
    Opacity="1",
    Metalness="0",
    Roughness="1",
    Diffuse=ColourSwatch(SwatchColor=RGB(189, 189, 189)),
    SelectedConstructorName="Objects.Other.RenderMaterial.ctor(System.Double,System.Double,System.Double,System.Nullable`1[System.Drawing.Color],System.Nullable`1[System.Drawing.Color])",
    SelectedTypeName="Objects.Other.RenderMaterial",
    UseSchemaTag=False,
    UserSetSchemaTag=False,
    seed="c65aab5024e53213a342")
rendermaterial_11 = RenderMaterial(
    Opacity="1",
    Metalness="0",
    Roughness="1",
    Diffuse=ColourSwatch(SwatchColor=RGB(178, 178, 178)),
    SelectedConstructorName="Objects.Other.RenderMaterial.ctor(System.Double,System.Double,System.Double,System.Nullable`1[System.Drawing.Color],System.Nullable`1[System.Drawing.Color])",
    SelectedTypeName="Objects.Other.RenderMaterial",
    UseSchemaTag=False,
    UserSetSchemaTag=False,
    seed="e2656b01266e4fc7e95d")
category = Category({"AbutmentFoundations": 0, "AbutmentPiles": 1, "AbutmentWalls": 2, "BridgeAbutments": 3, "DuctTerminal": 4, "Alignments": 5, "StructConnectionAnchors": 6, "ApproachSlabs": 7, "BridgeArches": 8, "AudioVisualDevices": 9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}, selected="Lines": 54)
python = GhPythonScript()  # -> out
# ---------- python: Python ----------
__author__ = "RivinduB"
__version__ = "2023.08.03"

import rhinoscriptsyntax as rs
import Rhino

my_doc = Rhino.RhinoDoc.CreateHeadless(None)
my_doc.ModelUnitSystem = Rhino.UnitSystem.Meters
Rhino.RhinoDoc.ActiveDoc = my_doc
# ---------- end python ----------
category_2 = Category({"AbutmentFoundations": 0, "AbutmentPiles": 1, "AbutmentWalls": 2, "BridgeAbutments": 3, "DuctTerminal": 4, "Alignments": 5, "StructConnectionAnchors": 6, "ApproachSlabs": 7, "BridgeArches": 8, "AudioVisualDevices": 9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}, selected="Lines": 54)
mesh = GetGeometry(AtLeast=1, AtMost=2147483647, DeleteInput=False, Filter=1074004029, TreeAccess=True)
buildings = GetGeometry(AtLeast=1, AtMost=2147483647, DeleteInput=False, Filter=1074004029, TreeAccess=True)
roads = GetGeometry(AtLeast=1, AtMost=2147483647, DeleteInput=False, Filter=1074004029, TreeAccess=True)
heritage = GetGeometry(AtLeast=1, AtMost=2147483647, DeleteInput=False, Filter=1074004029, TreeAccess=True)
contours = GetGeometry(AtLeast=1, AtMost=2147483647, DeleteInput=False, Filter=1074004029, TreeAccess=True)
flood = GetGeometry(AtLeast=1, AtMost=2147483647, DeleteInput=False, Filter=1074004029, TreeAccess=True)
parks = GetGeometry(AtLeast=1, AtMost=2147483647, DeleteInput=False, Filter=1074004029, TreeAccess=True)
isochrone = GetGeometry(AtLeast=1, AtMost=2147483647, DeleteInput=False, Filter=1074004029, TreeAccess=True)
native = GetGeometry(AtLeast=1, AtMost=2147483647, DeleteInput=False, Filter=1074004029, TreeAccess=True)
elevatedbuildings = GetGeometry(AtLeast=1, AtMost=2147483647, DeleteInput=False, Filter=1074004029, TreeAccess=True)
lots = GetGeometry(AtLeast=1, AtMost=2147483647, DeleteInput=False, Filter=1074004029, TreeAccess=True)
admin = GetGeometry(AtLeast=1, AtMost=2147483647, DeleteInput=False, Filter=1074004029, TreeAccess=True)
streamid = GetString(AtLeast=1, AtMost=2147483647, TreeAccess=True)
project = Project(Curve=flatten(lots), Brep=flatten(mesh), Direction=Vector(0, 0, 1))
project_2 = Project(Curve=flatten(roads), Brep=flatten(mesh), Direction=Vector(0, 0, 1))
revittopography = RevitTopography(
    DisplayMesh=mesh,
    SelectedConstructorName="Objects.BuiltElements.Revit.RevitTopography.ctor(Objects.Geometry.Mesh,System.Collections.Generic.List`1[Objects.BuiltElements.Revit.Parameter])",
    SelectedTypeName="Objects.BuiltElements.Revit.RevitTopography",
    UseSchemaTag=False,
    UserSetSchemaTag=False,
    seed="1a35f28e0ab8cd1c6664")
modelcurve = ModelCurve(
    BaseCurve=contours,
    LineStyle="DDG_Contours",
    SelectedConstructorName="Objects.BuiltElements.Revit.Curve.ModelCurve.ctor(Objects.ICurve,System.String,System.Collections.Generic.List`1[Objects.BuiltElements.Revit.Parameter])",
    SelectedTypeName="Objects.BuiltElements.Revit.Curve.ModelCurve",
    UseSchemaTag=False,
    UserSetSchemaTag=False,
    seed="ed219971c30e3abf0826")
modelcurve_2 = ModelCurve(
    BaseCurve=roads,
    LineStyle="DDG_Roads",
    SelectedConstructorName="Objects.BuiltElements.Revit.Curve.ModelCurve.ctor(Objects.ICurve,System.String,System.Collections.Generic.List`1[Objects.BuiltElements.Revit.Parameter])",
    SelectedTypeName="Objects.BuiltElements.Revit.Curve.ModelCurve",
    UseSchemaTag=False,
    UserSetSchemaTag=False,
    seed="cae901f2f954885ff7ee")
modelcurve_3 = ModelCurve(
    BaseCurve=lots,
    LineStyle="DDG_Lots",
    SelectedConstructorName="Objects.BuiltElements.Revit.Curve.ModelCurve.ctor(Objects.ICurve,System.String,System.Collections.Generic.List`1[Objects.BuiltElements.Revit.Parameter])",
    SelectedTypeName="Objects.BuiltElements.Revit.Curve.ModelCurve",
    UseSchemaTag=False,
    UserSetSchemaTag=False,
    seed="3dbc0a5319c336bb4c13")
to_speckle = ToSpeckle(Data=flatten(buildings), preprocessGeometry=False, selectedKitName="Objects")
modelcurve_4 = ModelCurve(
    BaseCurve=native,
    LineStyle="DDG_NativeTitle",
    SelectedConstructorName="Objects.BuiltElements.Revit.Curve.ModelCurve.ctor(Objects.ICurve,System.String,System.Collections.Generic.List`1[Objects.BuiltElements.Revit.Parameter])",
    SelectedTypeName="Objects.BuiltElements.Revit.Curve.ModelCurve",
    UseSchemaTag=False,
    UserSetSchemaTag=False,
    seed="8763e19d424114676f85")
modelcurve_5 = ModelCurve(
    BaseCurve=flood,
    LineStyle="DDG_Flood",
    SelectedConstructorName="Objects.BuiltElements.Revit.Curve.ModelCurve.ctor(Objects.ICurve,System.String,System.Collections.Generic.List`1[Objects.BuiltElements.Revit.Parameter])",
    SelectedTypeName="Objects.BuiltElements.Revit.Curve.ModelCurve",
    UseSchemaTag=False,
    UserSetSchemaTag=False,
    seed="be85a127bbc510d73c00")
modelcurve_6 = ModelCurve(
    BaseCurve=isochrone,
    LineStyle="DDG_Isochrone",
    SelectedConstructorName="Objects.BuiltElements.Revit.Curve.ModelCurve.ctor(Objects.ICurve,System.String,System.Collections.Generic.List`1[Objects.BuiltElements.Revit.Parameter])",
    SelectedTypeName="Objects.BuiltElements.Revit.Curve.ModelCurve",
    UseSchemaTag=False,
    UserSetSchemaTag=False,
    seed="8efc303e0747b9574657")
modelcurve_7 = ModelCurve(
    BaseCurve=admin,
    LineStyle="DDG_AdminBoundaries",
    SelectedConstructorName="Objects.BuiltElements.Revit.Curve.ModelCurve.ctor(Objects.ICurve,System.String,System.Collections.Generic.List`1[Objects.BuiltElements.Revit.Parameter])",
    SelectedTypeName="Objects.BuiltElements.Revit.Curve.ModelCurve",
    UseSchemaTag=False,
    UserSetSchemaTag=False,
    seed="b33c04958d7d62ab1119")
modelcurve_8 = ModelCurve(
    BaseCurve=heritage,
    LineStyle="DDG_Parks",
    SelectedConstructorName="Objects.BuiltElements.Revit.Curve.ModelCurve.ctor(Objects.ICurve,System.String,System.Collections.Generic.List`1[Objects.BuiltElements.Revit.Parameter])",
    SelectedTypeName="Objects.BuiltElements.Revit.Curve.ModelCurve",
    UseSchemaTag=False,
    UserSetSchemaTag=False,
    seed="1a051330469f8f8310d9")
modelcurve_9 = ModelCurve(
    BaseCurve=parks,
    LineStyle="DDG_Parks",
    SelectedConstructorName="Objects.BuiltElements.Revit.Curve.ModelCurve.ctor(Objects.ICurve,System.String,System.Collections.Generic.List`1[Objects.BuiltElements.Revit.Parameter])",
    SelectedTypeName="Objects.BuiltElements.Revit.Curve.ModelCurve",
    UseSchemaTag=False,
    UserSetSchemaTag=False,
    seed="4ed33a650aa5737759cc")
accst = AccountFromServerToken(Server="https://speckle.xyz/", AuthToken="091eabd976672b05e476e09b315f8bc1a254de4ca0")
directshape_by_base_geometries = DirectShapeByBaseGeometries(
    Name="DDG_Lots Elevated",
    Category=category,
    BaseGeometries=project,
    SelectedConstructorName="Objects.BuiltElements.Revit.DirectShape.ctor(System.String,Objects.BuiltElements.Revit.RevitCategory,System.Collections.Generic.List`1[Speckle.Core.Models.Base],System.Collections.Generic.List`1[Objects.BuiltElements.Revit.Parameter])",
    SelectedTypeName="Objects.BuiltElements.Revit.DirectShape",
    UseSchemaTag=False,
    UserSetSchemaTag=False,
    seed="82a49a41abe7d00cbbef")  # -> simplify(flatten(SpeckleObject))
parameter = Parameter(
    Name="Comments",
    Value="Buildings Elevated",
    SelectedConstructorName="Objects.BuiltElements.Revit.Parameter.ctor(System.String,System.Object,System.String)",
    SelectedTypeName="Objects.BuiltElements.Revit.Parameter",
    UseSchemaTag=False,
    UserSetSchemaTag=False,
    seed="7270b0e9ebe80b471156")
directshape_by_base_geometries_2 = DirectShapeByBaseGeometries(
    Name="DDG_Roads Elevated",
    Category=category_2,
    BaseGeometries=project_2,
    SelectedConstructorName="Objects.BuiltElements.Revit.DirectShape.ctor(System.String,Objects.BuiltElements.Revit.RevitCategory,System.Collections.Generic.List`1[Speckle.Core.Models.Base],System.Collections.Generic.List`1[Objects.BuiltElements.Revit.Parameter])",
    SelectedTypeName="Objects.BuiltElements.Revit.DirectShape",
    UseSchemaTag=False,
    UserSetSchemaTag=False,
    seed="7b73237f0dd48f1076dd")
sget = StreamGet(StreamIDURL=flatten(streamid), SpeckleAccount=accst)
eso = ExtendSpeckleObject(SpeckleObject=to_speckle, RenderMaterial=rendermaterial_8, selectedKitName="Objects")
to_speckle_2 = ToSpeckle(Data=flatten(modelcurve_6), preprocessGeometry=False, selectedKitName="Objects")
to_speckle_3 = ToSpeckle(Data=flatten(modelcurve), preprocessGeometry=False, selectedKitName="Objects")
to_speckle_4 = ToSpeckle(Data=flatten(modelcurve_2), preprocessGeometry=False, selectedKitName="Objects")
to_speckle_5 = ToSpeckle(Data=flatten(modelcurve_3), preprocessGeometry=False, selectedKitName="Objects")
to_speckle_6 = ToSpeckle(Data=flatten(modelcurve_9), preprocessGeometry=False, selectedKitName="Objects")
to_speckle_7 = ToSpeckle(Data=flatten(modelcurve_4), preprocessGeometry=False, selectedKitName="Objects")
to_speckle_8 = ToSpeckle(Data=flatten(modelcurve_5), preprocessGeometry=False, selectedKitName="Objects")
to_speckle_9 = ToSpeckle(Data=flatten(modelcurve_7), preprocessGeometry=False, selectedKitName="Objects")
to_speckle_10 = ToSpeckle(Data=flatten(modelcurve_8), preprocessGeometry=False, selectedKitName="Objects")
eso_2 = ExtendSpeckleObject(SpeckleObject=to_speckle_2, RenderMaterial=rendermaterial_7, selectedKitName="Objects")
eso_3 = ExtendSpeckleObject(SpeckleObject=to_speckle_3, RenderMaterial=rendermaterial_9, selectedKitName="Objects")
eso_4 = ExtendSpeckleObject(SpeckleObject=to_speckle_4, RenderMaterial=rendermaterial_10, selectedKitName="Objects")
eso_5 = ExtendSpeckleObject(SpeckleObject=to_speckle_5, RenderMaterial=rendermaterial_11, selectedKitName="Objects")
eso_6 = ExtendSpeckleObject(SpeckleObject=to_speckle_6, RenderMaterial=rendermaterial_2, selectedKitName="Objects")
freeform_element = FreeformElement(
    BaseGeometries=elevatedbuildings,
    Subcategory="Buildings Elevated",
    Parameters=parameter,
    SelectedConstructorName="Objects.BuiltElements.Revit.FreeformElement.ctor(System.Collections.Generic.List`1[Speckle.Core.Models.Base],System.String,System.Collections.Generic.List`1[Objects.BuiltElements.Revit.Parameter])",
    SelectedTypeName="Objects.BuiltElements.Revit.FreeformElement",
    UseSchemaTag=False,
    UserSetSchemaTag=False,
    seed="83416a0d9a51ad412098")
eso_7 = ExtendSpeckleObject(SpeckleObject=to_speckle_7, RenderMaterial=rendermaterial_3, selectedKitName="Objects")
eso_8 = ExtendSpeckleObject(SpeckleObject=to_speckle_8, RenderMaterial=rendermaterial_4, selectedKitName="Objects")
eso_9 = ExtendSpeckleObject(SpeckleObject=to_speckle_9, RenderMaterial=rendermaterial_5, selectedKitName="Objects")
eso_10 = ExtendSpeckleObject(SpeckleObject=to_speckle_10, RenderMaterial=rendermaterial_6, selectedKitName="Objects")
to_speckle_11 = ToSpeckle(Data=directshape_by_base_geometries_2, preprocessGeometry=False, selectedKitName="Objects")
to_speckle_12 = ToSpeckle(Data=flatten(directshape_by_base_geometries), preprocessGeometry=False, selectedKitName="Objects")
to_speckle_13 = ToSpeckle(Data=flatten(revittopography), preprocessGeometry=False, selectedKitName="Objects")
to_speckle_14 = ToSpeckle(Data=flatten(freeform_element), preprocessGeometry=False, selectedKitName="Objects")
eso_11 = ExtendSpeckleObject(SpeckleObject=to_speckle_14, RenderMaterial=rendermaterial, selectedKitName="Objects")
ss = SynchronousSender(Data=eso_2, Stream=sget, Message="Isochrones", UseDefaultCache=True, selectedKitName="Objects")
ss_2 = SynchronousSender(
    Data=to_speckle_13,
    Stream=sget,
    Message="Topography for Revit",
    OutputWrappers="https://speckle.xyz\t6928d0bb9a\t165eb6dcd1",
    UseDefaultCache=True,
    selectedKitName="Objects")
ss_3 = SynchronousSender(
    Data=eso,
    Stream=sget,
    Message="Buildings for Revit",
    OutputWrappers="https://speckle.xyz\t833c312f80\t0616e71eb6",
    UseDefaultCache=True,
    selectedKitName="Objects")
ss_4 = SynchronousSender(
    Data=eso_3,
    Stream=sget,
    Message="Contours for Revit",
    OutputWrappers="https://speckle.xyz\t833c312f80\td4c20c6f95",
    UseDefaultCache=True,
    selectedKitName="Objects")
ss_5 = SynchronousSender(
    Data=eso_4,
    Stream=sget,
    Message="Roads for Revit",
    OutputWrappers="https://speckle.xyz\t833c312f80\td4c20c6f95",
    UseDefaultCache=True,
    selectedKitName="Objects")
ss_6 = SynchronousSender(
    Data=eso_5,
    Stream=sget,
    Message="Lots for Revit",
    OutputWrappers="https://speckle.xyz\t833c312f80\td4c20c6f95",
    UseDefaultCache=True,
    selectedKitName="Objects")
ss_7 = SynchronousSender(Data=eso_6, Stream=sget, Message="Parks", UseDefaultCache=True, selectedKitName="Objects")
ss_8 = SynchronousSender(
    Data=eso_10,
    Stream=sget,
    Message="Heritage",
    OutputWrappers="https://speckle.xyz\t833c312f80\td4c20c6f95",
    UseDefaultCache=True,
    selectedKitName="Objects")
ss_9 = SynchronousSender(Data=eso_8, Stream=sget, Message="Floods", UseDefaultCache=True, selectedKitName="Objects")
ss_10 = SynchronousSender(Data=eso_7, Stream=sget, Message="Native Title", UseDefaultCache=True, selectedKitName="Objects")
ss_11 = SynchronousSender(Data=eso_9, Stream=sget, Message="Administration Boundaries", UseDefaultCache=True, selectedKitName="Objects")
ss_12 = SynchronousSender(Data=eso_11, Stream=sget, Message="Buildings Elevated for Revit", UseDefaultCache=True, selectedKitName="Objects")
ss_13 = SynchronousSender(Data=to_speckle_12, Stream=sget, Message="Lots Elevated", UseDefaultCache=True, selectedKitName="Objects")
ss_14 = SynchronousSender(Data=to_speckle_11, Stream=sget, Message="Roads Elevated", UseDefaultCache=True, selectedKitName="Objects")

# ---- group: RH_OUT:Stream
txt = Text(ss_2)
