# Grasshopper definition zoning.ghx (Grasshopper 1.0.7)

zoning = GetString(AtLeast=1, AtMost=2147483647, TreeAccess=True)
curves = GetGeometry(AtLeast=1, AtMost=2147483647, DeleteInput=False, Filter=1074004029, TreeAccess=True)
flatten = FlattenTree(Tree=curves, Path="{0}")
flatten_2 = FlattenTree(Tree=zoning, Path="{0}")
lng = ListLength(List=flatten)
sort = SortList(Keys=flatten, ValuesA=flatten, ValuesC=flatten_2)  # -> Keys, ValuesA, ValuesC
cset = CreateSet(List=sort.ValuesC)  # -> Set, Map
lng_2 = ListLength(List=cset.Set)  # -> expr("x-1", Length)
series = Series(Start=0, Step=Slider(0.0001, range=0..0.0001), Count=lng)
gradient = Gradient(LowerLimit=0, UpperLimit=lng_2, Parameter=cset.Map, stops=[0: RGB(0, 128, 0), 0.5: RGB(255, 255, 0), 1: RGB(255, 0, 0)])
Z = UnitZ(Factor=series)  # -> expr("-x", UnitVector)
move = Move(Geometry=sort.ValuesA, Motion=Z)  # -> Geometry, Transform
mcol = MeshColours(Mesh=graft(move.Geometry), Colours=graft(gradient))

# ---- group: RH_OUT:Zone
txt = Text(flatten(sort.ValuesC))

# ---- group: RH_OUT:Mesh
mesh = Mesh(mcol)
