# Grasshopper definition zoningColors.ghx (Grasshopper 1.0.7)
# plug-ins: GraphicPlus

filename = GetString(AtLeast=1, AtMost=2147483647, TreeAccess=True)
geometry = GetGeometry(AtLeast=1, AtMost=2147483647, DeleteInput=False, Filter=1074004029, TreeAccess=True)
vals = GetString(AtLeast=1, AtMost=2147483647, TreeAccess=True)
foldername = GetString(AtLeast=1, AtMost=1, TreeAccess=False)
flatten = FlattenTree(Tree=filename, Path="{0}")
flatten_2 = FlattenTree(Tree=geometry, Path="{0}")
flatten_3 = FlattenTree(Tree=vals, Path="{0}")
flatten_4 = FlattenTree(Tree=foldername, Path="{0}")
mesh = Mesh(flatten_2)
number_slider = Slider(2000, range=0..10000)
concat = Concatenate(FragmentA="C:\Users\Administrator\OneDrive - nettletontribe\Compute\", FragmentB=flatten_4)
sort = SortList(Keys=mesh, ValuesA=mesh, ValuesB=flatten_3)  # -> Keys, reverse(ValuesA), reverse(ValuesB)
cset = CreateSet(List=sort.ValuesB)  # -> Set, Map
lng = ListLength(List=cset.Set)
data = Data(["CA", "2(a)", "A", "AGB", "B", "B1", "B2", "B2", "B3", "B4"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])
data_2 = Data(["0, 0, 0, 0", "255, 166, 163, 255", "252, 119, 110, 255", "250, 232, 197, 255", "99, 240, 245, 255", "201, 255, 249, 255", "98, 240, 245, 255", "98, 240, 245, 255", "0, 194, 237, 255", "149, 157, 194, 255"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])
dom = ConstructDomain(DomainStart=expr("-x", number_slider), DomainEnd=number_slider)
keysearch = KeyValueSearch(Keys=data, Values=data_2, Search=flatten_3)
rectangle = Rectangle(Plane=PlaneXY(0, 0, 0), XSize=dom, YSize=dom, Radius=0)  # -> Rectangle, Length
solid = SolidFill(ShapeGeometry=sort.ValuesA, Color=keysearch)
drawing = ConstructDrawing(ShapesGeometry=solid, Boundary=rectangle.Rectangle, Color=RGBA(255, 255, 255, 0))  # -> Drawing, Boundary
savebmp = SaveBitmap(
    DrawingsShapesGeometry=drawing.Drawing,
    FolderPath=concat,
    FileName=flatten,
    Extension=0,
    Resolution=96,
    Save=Toggle(True))

# ---- group: RH_OUT:Path
data_3 = Data(savebmp)
